# Dynamo graph Place Wall Openings for Linked Ducts and Pipes.dyn (Dynamo 2.19.3.6394)
# packages: bimorphNodes 5.1.3, Rhythm 2022.7.2

# group: Parameters
# Linked Model: Select linked model containing pipes/ducts
# Insulation thickness: inches if project uses imperial, mm if metric
pipe_opening_family_type = FamilyTypes("Round Opening for Pipes:Base")
linked_model = Links("M_MDHS_PAC_Central_R24.rvt : 14 : location <Not Shared>")
pipe_insulation_thickness_in_or = DoubleInput(25)  # "Pipe Insulation Thickness (in or mm)"
family_types = FamilyTypes("Opening For Ducts:Base")
duct_insulation_thickness_in_or = DoubleInput(10)  # "Duct Insulation Thickness (in or mm)"

# group: Get elements
# Gets all wall elements (in model) and pipe/duct elements (from LINKED FILE)
categories = Categories("OST_Walls")
all_elements_of_category = ElementsOfCategory(Category=categories)
categories_2 = Categories("OST_PipeCurves")
ofCategory = Revit.LinkElement.OfCategory(linkInstance=linked_model, category=categories_2)
categories_3 = Categories("OST_DuctCurves")
ofCategory_2 = Revit.LinkElement.OfCategory(linkInstance=linked_model, category=categories_3)

# group: Pipe Openings > Get Geometries of Intersecting Pipes
# Collects intersecting pipe and wall elements and returns their geometries
# Custom Python node flattens the input lists and returns two lists of the pipe geometry and wall geometry where each index represents one intersection
intersectsElement = Revit.Element.IntersectsElement(elementSetA=all_elements_of_category, elementSetB=ofCategory)
get_intersecting_pipe_elements = Results.ElementIntersectionResult.IntersectingElements(elementIntersectionResult=intersectsElement)
geometry = Element.Geometry(element=get_intersecting_pipe_elements)
get_corresponding_walls = Results.ElementIntersectionResult.Element(elementIntersectionResult=intersectsElement)
get_geometry_intersections = Python(IN[0]=geometry, IN[1]=get_corresponding_walls)  # CPython3
# ---------- get_geometry_intersections.python (23 lines) ----------
# Load the Python Standard and DesignScript Libraries
import sys
import clr
clr.AddReference('ProtoGeometry')
from Autodesk.DesignScript.Geometry import *
from Revit import Elements

# The inputs to this node will be stored as a list in the IN variables.
geometry = IN[0]
walls = IN[1]

output = []
wallout = []

for i, wall in enumerate(geometry):
    for index in wall:
        for element in index:
            wallout.append(walls[i])
            output.append(Geometry.Intersect(element, Elements.Element.Geometry(walls[i])[0])[0])


# Assign your output to the OUT variable.
OUT = [output, wallout]
# ----------------------------------------

# group: Ref: RevitAPI DisplayUnits Class
# Returns scaling value based on unit type of project.
# METRIC = 1
# IMPERIAL = 12
# Divide all measurements by scale (SetParameter uses mm and feet by default, for some reason)
get_project_units = Python()  # CPython3
# ---------- get_project_units.python (24 lines) ----------
# Load the Python Standard and DesignScript Libraries
import sys
import clr
import RevitServices

clr.AddReference("RevitAPI")
clr.AddReference('ProtoGeometry')
clr.AddReference("RevitServices")

from Autodesk.Revit.DB import *

from Autodesk.DesignScript.Geometry import *
from RevitServices.Persistence import DocumentManager

# The inputs to this node will be stored as a list in the IN variables.

units = DocumentManager.Instance.CurrentDBDocument.DisplayUnitSystem

# Place your code below this line



# Assign your output to the OUT variable.
OUT = 12 if units else 1
# ----------------------------------------

# group: Pipe Openings > Get Shift Amount
# Returns a vector that represents the amount to shift the opening down in order to center it along the pipe
ZAxis = Vector.ZAxis()
code_block = CodeBlock { "Outside Diameter"; }
ʳʰʸᵗʰᵐ_elements = Rhythm.Revit.Elements.Elements.GetParameterValueByNameTypeOrInstance(element=get_intersecting_pipe_elements, parameterName=code_block)
flatten = List.Flatten(list=ʳʰʸᵗʰᵐ_elements)
code_block_2 = CodeBlock(diameter=flatten, thickness=pipe_insulation_thickness_in_or, scale=get_project_units) { ((diameter / 2) + thickness) / scale; (diameter + (2 * thickness)) / scale; }
scale = Vector.Scale(vector=ZAxis, scale_factor=code_block_2.out0)

# group: Pipe Openings
indexes = CodeBlock { 0; 1; }
getItemAtIndex = List.GetItemAtIndex(list=get_geometry_intersections, index=indexes.out1)

# group: Pipe Openings > Find Center Point of Intersection
# Returns point at the center of the intersection face between pipe and wall
# Get list of pipe geometries -> Explode the geometries (cubes) into individual surfaces (faces) -> Get only first face -> Return center of the face
getItemAtIndex_2 = List.GetItemAtIndex(list=get_geometry_intersections, index=indexes.out0)
explode = Geometry.Explode(geometry=getItemAtIndex_2)
getItemAtIndex_3 = List.GetItemAtIndex(list=explode@L2, index=indexes.out0)
code_block_3 = CodeBlock { 0.5; }
pointAtParameter = Surface.PointAtParameter(surface=getItemAtIndex_3, u=code_block_3, v=code_block_3)

# group (continued): Pipe Openings
subtract = Point.Subtract(point=pointAtParameter, vectorToSubtract=scale)

# group: Pipe Openings > Create Wall Opening
# Using the pipe opening Family Type selected in Parameters, places an instance of that family on the specified point
# Then scales up the opening to fit pipe with desired thickness
byHostAndPoint = FamilyInstance.ByHostAndPoint(familyType=pipe_opening_family_type, host=getItemAtIndex, point=subtract)
code_block_4 = CodeBlock { "Diameter"; }
setParameterByName = Element.SetParameterByName(element=byHostAndPoint, parameterName=code_block_4, value=code_block_2.out1)

# group: Duct Openings > Get Geometries of Intersecting Ducts
# Collects intersecting duct and wall elements and returns their geometries
# Custom Python node flattens the input lists and returns two lists of the duct geometry and wall geometry where each index represents one intersection
intersectsElement_2 = Revit.Element.IntersectsElement(elementSetA=all_elements_of_category, elementSetB=ofCategory_2)
intersectingElements = Results.ElementIntersectionResult.IntersectingElements(elementIntersectionResult=intersectsElement_2)
geometry_2 = Element.Geometry(element=intersectingElements)
element = Results.ElementIntersectionResult.Element(elementIntersectionResult=intersectsElement_2)
get_geometry_intersections_2 = Python(IN[0]=geometry_2, IN[1]=element)  # CPython3; same code as get_geometry_intersections

# group: Duct Openings > Get Shift Amount (Based on Family)
# Returns a vector that represents the amount to shift the opening down in order to center it along the pipe
# Custom Python scripts replace width/heights with diameters if the duct is round
ZAxis_2 = Vector.ZAxis()
flatten_2 = List.Flatten(list=intersectingElements)
elementType = Revit.LinkElement.ElementType(linkElement=flatten_2)
familyName = ElementType.FamilyName(elementType=elementType)
get_widths_diameters = Python(IN[0]=flatten_2, IN[1]=familyName)  # CPython3
# ---------- get_widths_diameters.python (21 lines) ----------
# Load the Python Standard and DesignScript Libraries
import sys
import clr
clr.AddReference('ProtoGeometry')
from Autodesk.DesignScript.Geometry import *
from Rhythm.Revit.Elements import *

# The inputs to this node will be stored as a list in the IN variables.
elements = IN[0]
types = IN[1]

output = []
# Place your code below this line

for i, element in enumerate(elements):
    if(types[i] == "Round Duct"):
        output.append(Elements.GetParameterValueByNameTypeOrInstance(element, "Diameter"))
    else:
        output.append(Elements.GetParameterValueByNameTypeOrInstance(element, "Width"))
# Assign your output to the OUT variable.
OUT = output
# ----------------------------------------
get_heights_diameters = Python(IN[0]=flatten_2, IN[1]=familyName)  # CPython3
# ---------- get_heights_diameters.python (21 lines) ----------
# Load the Python Standard and DesignScript Libraries
import sys
import clr
clr.AddReference('ProtoGeometry')
from Autodesk.DesignScript.Geometry import *
from Rhythm.Revit.Elements import *

# The inputs to this node will be stored as a list in the IN variables.
elements = IN[0]
types = IN[1]

output = []
# Place your code below this line

for i, element in enumerate(elements):
    if(types[i] == "Round Duct"):
        output.append(Elements.GetParameterValueByNameTypeOrInstance(element, "Diameter"))
    else:
        output.append(Elements.GetParameterValueByNameTypeOrInstance(element, "Height"))
# Assign your output to the OUT variable.
OUT = output
# ----------------------------------------
code_block_5 = CodeBlock(width=get_widths_diameters, thickness=duct_insulation_thickness_in_or, scale=get_project_units, height=get_heights_diameters) { (width+2*thickness)/(scale); (height+2*thickness)/(scale); ((height / 2) + thickness) / scale; }
scale_2 = Vector.Scale(vector=ZAxis_2, scale_factor=code_block_5.out2)

# group: Duct Openings
code_block_6 = CodeBlock { 0; 1; }
getItemAtIndex_4 = List.GetItemAtIndex(list=get_geometry_intersections_2, index=code_block_6.out1)
code_block_7 = CodeBlock { "Width"; "Height"; }

# group: Duct Openings > Find Center Point of Intersection
# Returns point at the center of the intersection face between pipe and wall
# Get list of pipe geometries -> Explode the geometries (cubes) into individual surfaces (faces) -> Get only first face -> Return center of the face
getItemAtIndex_5 = List.GetItemAtIndex(list=get_geometry_intersections_2, index=code_block_6.out0)
explode_2 = Geometry.Explode(geometry=getItemAtIndex_5)
getItemAtIndex_6 = List.GetItemAtIndex(list=explode_2@L2, index=code_block_6.out0)
code_block_8 = CodeBlock { 0.5; }
pointAtParameter_2 = Surface.PointAtParameter(surface=getItemAtIndex_6, u=code_block_8, v=code_block_8)

# group (continued): Duct Openings
subtract_2 = Point.Subtract(point=pointAtParameter_2, vectorToSubtract=scale_2)
byHostAndPoint_2 = FamilyInstance.ByHostAndPoint(familyType=family_types, host=getItemAtIndex_4, point=subtract_2)
setParameterByName_2 = Element.SetParameterByName(element=byHostAndPoint_2, parameterName=code_block_7.out1, value=code_block_5.out1)
setParameterByName_3 = Element.SetParameterByName(element=byHostAndPoint_2, parameterName=code_block_7.out0, value=code_block_5.out0)
